# Dynamo custom node ImportInstance.IsLinked.dyf (Dynamo 1.3.3.4111)
# category: Data-Shapes.Revit.Elements
# Returns boolean info indicating wether an ImportInstance is linked or not (meaning it's imported).

ImportInstance_s = Input()  # "ImportInstance(s)"
isLinked = Python(IN[0]=ImportInstance_s)
# ---------- isLinked.python (17 lines) ----------
#Copyright (c) Data Shapes - Mostafa El Ayoubi ,  2018
# @data_shapes ,  www.data-shapes.io , contact@data-shapes.io

import clr
clr.AddReference('RevitAPI')
from Autodesk.Revit.DB import *

def toList(input):
	if isinstance(input,list):
		return UnwrapElement(input)
	else:
		return [UnwrapElement(input)]
	
importInstances = toList(IN[0])


OUT = [importInstance.IsLinked for importInstance in importInstances]
# ----------------------------------------
bool = Output(isLinked)
