# Grasshopper definition Rhino Revit Brep + Mesh.gh (Grasshopper 1.0.7)
# plug-ins: eleFront, Rhino.Inside for Autodesk Revit

panel = Panel("""Walls prueba
Glass""")
reflay = ReferenceByLayer(LayerName="topo", lightweight=False)
reflay_2 = ReferenceByLayer(LayerName=panel, lightweight=False)
panel_2 = Panel("""Walls
Curtain Panels""")
panel_3 = Panel(reflay)
panel_4 = Panel(reflay_2)
filtertype = FilterByType(ObjectType="Brep", Geometry=reflay_2, invertFilter=False, returnNulls=False)  # -> ExcludedGeometry, IncludedGeometry
keysearch = KeyValueSearch(Keys="topo", Values="Topography", Search="topo")
keysearch_2 = KeyValueSearch(Keys=panel, Values=panel_2, Search=panel)
categories = QueryCategories(Type=1, Name=keysearch, IsVisibleUI=True, IsSubcategory=False)
categories_2 = QueryCategories(Type=1, Name=keysearch_2, IsVisibleUI=True, IsSubcategory=False)
panel_5 = Panel("Brep")
g_shape = AddDirectShapeGeometry(Category=categories, Geometry=reflay, TrackingMode=2)
categories_3 = BuiltInCategories(SearchPattern="floor")
g_shape_2 = AddDirectShapeGeometry(Category=categories_2, Geometry=filtertype.IncludedGeometry, TrackingMode=2)
panel_6 = Panel(categories)
panel_7 = Panel(categories_2)
panel_8 = Panel(g_shape)
panel_9 = Panel(g_shape_2)
