# Grasshopper definition Rhino Revit Brep.gh (Grasshopper 1.0.7)
# plug-ins: eleFront, Rhino.Inside for Autodesk Revit

panel = Panel("""Walls prueba
Glass
Mass prueba
Stairs prueba
Floors prueba""")
reflay = ReferenceByLayer(LayerName=panel, lightweight=False)
panel_2 = Panel("""Walls
Curtain Panels
Mass
Stairs
Floors""")
panel_3 = Panel(reflay)
categories = BuiltInCategories(SearchPattern="mass")
filtertype = FilterByType(ObjectType="Brep", Geometry=reflay, invertFilter=False, returnNulls=False)  # -> ExcludedGeometry, IncludedGeometry
keysearch = KeyValueSearch(Keys=panel, Values=panel_2, Search=panel)
panel_4 = Panel(keysearch)
categories_2 = QueryCategories(Type=1, Name=keysearch, IsVisibleUI=True, IsSubcategory=False)
g_shape = AddDirectShapeGeometry(Category=categories_2, Geometry=filtertype.IncludedGeometry, TrackingMode=2)
panel_5 = Panel(categories_2)
panel_6 = Panel(filtertype.IncludedGeometry)
panel_7 = Panel(g_shape)
