# Dynamo custom node Filter.IsApplied.dyf (Dynamo 1.3.3.4111)
# category: Data-Shapes.Revit.Elements
# Returns a boolean values indicating wether a ParameterFilterElement is applied to any view in the project or not.

ParameterFilterElement_s = Input()  # "ParameterFilterElement(s)"
isApplied = Python(IN[0]=ParameterFilterElement_s)  # "Filter.IsApplied"
# ---------- isApplied.python (36 lines) ----------
#Copyright (c) Data Shapes - Mostafa El Ayoubi ,  2018
# @data_shapes ,  www.data-shapes.io , contact@data-shapes.io

import clr
clr.AddReference('RevitAPI')
from Autodesk.Revit.DB import *
clr.AddReference('RevitServices')
from RevitServices.Persistence import DocumentManager
doc = DocumentManager.Instance.CurrentDBDocument

allViews = [v for v in FilteredElementCollector(doc).OfClass(View).ToElements() if v.IsValidObject]

def toList(input):
	if isinstance(input,list):
		return UnwrapElement(input)
	else:
		return [UnwrapElement(input)]

parameterFilterElements = toList(IN[0])

appliedFilters = []

for view in allViews:
	try:
		viewFilters = view.GetFilters()
		for viewFilter in viewFilters:
			if  viewFilter not in appliedFilters:
				appliedFilters.append(viewFilter)
			else:
				continue
	except:
		pass
		
isApplied = [pfe.Id in appliedFilters for pfe in parameterFilterElements]

OUT = isApplied
# ----------------------------------------
bool = Output(isApplied)
