# Dynamo graph SetFamilyParametersValues.dyn "CargaValoresParametros" (Dynamo 2.3.0.5885)
# packages: Crumple 2022.2.13

# group: Abrir familias
carpeta_de_familias_directory = Directory("C:\Users\Maximiliano\Downloads\Script parametros\Families")  # "Carpeta de familias - (Directory Path)"; graph input
code_block = CodeBlock { ".rfa"; }
deep_search = BoolSelector(false)  # graph input
directorycontents = Custom[© DirectoryContents](directoryPath=carpeta_de_familias_directory, searchString=code_block, deepSearch=deep_search)  # package Crumple; Be aware there is an OOTB node that can do this, but I wanted to add this to the package so others can see how to use a Python method as a starter block in other scripts.
familydocopen = Custom[© FamilyDocOpen](filePaths=directorycontents)  # package Crumple; Given a file path to a family, attempts to open that document in the background in Revit if possible. Should not be used for regular models/templates.

nombre_hoja_de_excel = StringInput("")  # graph input

# group: Procesamiento datos de excel.
ubicacion_archivo_excel = Filename(".\05-Prueba.xlsx")  # graph input
code_block_2 = CodeBlock { true; false; false; }
quickimportexcel = Custom[© QuickImportExcel](filePath=ubicacion_archivo_excel, workSheet=nombre_hoja_de_excel, asStrings=code_block_2.out0, showExcel=code_block_2.out1, transpose=code_block_2.out2)  # package Crumple; The Import excel node, but with some streamlining features introduced. I mainly made this as I am constantly doing this setup and wanted to simplify it down to one node.
deconstruct = List.Deconstruct(list=quickimportexcel.headers)
si_pongo_1_podria_ver_si_se = CodeBlock { 2; }  # "Si pongo 1, podria ver si se pueden modificar los family type"
dropItems = List.DropItems(list=deconstruct.first, amount=si_pongo_1_podria_ver_si_se)

python_script = Python(IN[0]=familydocopen.familyDocs, IN[1]=dropItems, IN[2]=quickimportexcel.data)
# ---------- python_script.python (83 lines) ----------
# Made by Gavin Crump
# Free for use
# BIM Guru, www.bimguru.com.au

# Boilerplate text
import clr

clr.AddReference("RevitServices")
import RevitServices
from RevitServices.Persistence import DocumentManager
from RevitServices.Transactions import TransactionManager 

clr.AddReference("RevitAPI")
import Autodesk 
from Autodesk.Revit.DB import *

# Preparing input from dynamo to revit
famDocs  = IN[0]
famNames = [f.Title for f in famDocs]

# Get all the data we need to check vs excel
famTypesList, famTypeNamesList, famNames, famParamsList, famParamNamesList, = [],[],[],[],[]

for f in famDocs:
	# Get family name and manager
	famMan = f.FamilyManager
	famNames.append(f.Title)
	# Get type data
	famTypes  = list(famMan.Types)
	typeNames = [f.Name for f in famTypes]
	famTypesList.append(famTypes)
	famTypeNamesList.append(typeNames)
	# Get paramaters
	params = famMan.GetParameters()
	paramNames = [p.Definition.Name for p in params]
	famParamsList.append(params)
	famParamNamesList.append(paramNames)

# Function to set family parameter value for a type
def setFamilyParam(famDoc,p,t,v):
	try:
		famMan = famDoc.FamilyManager
		famMan.CurrentType = t
		famMan.Set(p,v)
		return True
	except:
		return False

# Work through excel data
paramNames = IN[1]
excelData  = IN[2]

outcomesList = []

for row in excelData:
	# Results for this row
	outcomes = []
	# Get the family
	famInd = famNames.index(row[0])
	famDoc = famDocs[famInd]
	# Get the type
	typeInd = famTypeNamesList[famInd].index(row[1])
	famType = famTypesList[famInd][typeInd]
	# Limit to the parameter columns
	values = row[2:]
	# Start a transaction in the family document
	t = Transaction(famDoc, row[0]+" - "+row[1])
	t.Start()
	# For each param/value pair for this type...
	for p,v in zip(paramNames,values):
		# Get the parameter
		parInd = famParamNamesList[famInd].index(p)
		famPar = famParamsList[famInd][parInd]
		# Set the parameter
		setParam = setFamilyParam(famDoc,famPar,famType,v)
		outcomes.append(setParam)
	# Commit the transaction
	t.Commit()
	# Append outcomes to list
	outcomesList.append(outcomes)

# Preparing output to Dynamo
OUT = outcomesList
# ----------------------------------------

# group: Cerrar documentos de familias
waitfor = Custom[© WaitFor](data=familydocopen.familyDocs, waitFor=python_script)  # package Crumple; Tells the first input to wait for the second input to arrive, then passes on the first input. Really useful for scripts which have branching paths that rely on their outputs to carry each other forward. Quite a few custom packages have a 'passthrough' or 'waitfor' node. I use these all the time, so find it useful to have them contained in this package also.
code_block_3 = CodeBlock { true; }
familydocclose = Custom[© FamilyDocClose](familyDoc=waitfor, saveOption=code_block_3)  # package Crumple; Given documents in the unwrapped state, attempts to close then with the option to save them (applies to all documents, one input expected, not a list).
