# Dynamo graph Load_FamilyParameters.dyn "Demo script" (Dynamo 2.3.1.11775)
# packages: Crumple 2022.2.13

which_directory_are_your = Directory("D:\Inzza\Familias\Mindfullnes OP1")  # "Which directory are your families in?"; graph input
code_block = CodeBlock { ".rfa"; }
include_subdirectories_infinite = BoolSelector(false)  # "Include subdirectories (infinite depth)"; graph input
directorycontents = Custom[© DirectoryContents](directoryPath=which_directory_are_your, searchString=code_block, deepSearch=include_subdirectories_infinite)  # package Crumple; Be aware there is an OOTB node that can do this, but I wanted to add this to the package so others can see how to use a Python method as a starter block in other scripts.
familydocopen = Custom[© FamilyDocOpen](filePaths=directorycontents)  # package Crumple; Given a file path to a family, attempts to open that document in the background in Revit if possible. Should not be used for regular models/templates.
sharedparametersflat = Custom[© SharedParametersFlat]()  # package Crumple; Returns all shared parameters as definition and name, as well as their corresponding group and name.
parameters_guidance_file = Filename(".\AddParameters.xlsx")  # "Parameters guidance file location"; graph input
file_from_path = FileObject(path=parameters_guidance_file)
worksheet_name_in_excel = StringInput("Standard")  # graph input
code_block_2 = CodeBlock { true; false; }
importExcel = Data.ImportExcel(file=file_from_path, sheetName=worksheet_name_in_excel, readAsStrings=code_block_2.out0, showExcel=code_block_2.out1)
restOfItems = List.RestOfItems(list=importExcel)
transpose = List.Transpose(lists=restOfItems)
code_block_3 = CodeBlock(data=transpose) { name = data[0]; bipg = data[2]; inst = data[3] == "Yes"; }
indexOf = List.IndexOf(list=sharedparametersflat.paramNames, element=code_block_3.name)
code_block_4 = CodeBlock(pdef=sharedparametersflat.paramDefs, i=indexOf) { pdef[i]; }
bipgbyname = Custom[© BIPGbyName](names=code_block_3.bipg)  # package Crumple; Given a string or list of strings, return the corresponding BuiltIn Parameter Group.
familydocaddsharedparameter = Custom[© FamilyDocAddSharedParameter](familyDoc=familydocopen.familyDocs, exDefs=code_block_4, bipgs=bipgbyname, isInstance=code_block_3.inst)  # package Crumple; Given a document or list of documents, attempts to add a list of shared parameters to them. Parameters should be in the form of unwrapped external definitions and BIPG's should be in unwrapped form as well.
waitfor = Custom[© WaitFor](data=familydocopen.familyDocs, waitFor=familydocaddsharedparameter)  # package Crumple; Tells the first input to wait for the second input to arrive, then passes on the first input. Really useful for scripts which have branching paths that rely on their outputs to carry each other forward. Quite a few custom packages have a 'passthrough' or 'waitfor' node. I use these all the time, so find it useful to have them contained in this package also.
code_block_5 = CodeBlock { true; }
familydocclose = Custom[© FamilyDocClose](familyDoc=waitfor, saveOption=code_block_5)  # package Crumple; Given documents in the unwrapped state, attempts to close then with the option to save them (applies to all documents, one input expected, not a list).
