# Dynamo graph FamilyTypeChange.dyn (Dynamo 2.13.1.3887)
# packages: Clockwork for Dynamo 2.x 2.3.0

categories = Categories("OST_Furniture")  # graph input
all_family_types_of_category = Custom[All Family Types Of Category](category=categories)  # package Clockwork for Dynamo 2.x; Gets all family types/symbols of a given category in the model.
name = Element.Name(element=all_family_types_of_category)
código_anterior = StringInput("INZZ")  # graph input
código_nuevo = StringInput("INZ")  # graph input
replace = String.Replace(string=name, searchFor=código_anterior, replaceWith=código_nuevo)
setName = Custom[Element.SetName](element=all_family_types_of_category, name=replace)  # package Clockwork for Dynamo 2.x; Gets the name of a given Revit element
