# Dynamo graph ViewTemplateNameChange.dyn (Dynamo 2.13.1.3887)
# packages: Clockwork for Dynamo 2.x 2.3.0

categories = Categories("OST_Views")  # graph input
all_elements_of_category = ElementsOfCategory(Category=categories)
boolean = BoolSelector(false)
clean = List.Clean(list=all_elements_of_category, preserveIndices=boolean)
isViewTemplate = View.IsViewTemplate(view=clean)
filterByBoolMask = List.FilterByBoolMask(list=clean, mask=isViewTemplate)
name = Element.Name(element=filterByBoolMask.in)
string = StringInput("EDZ")
string_2 = StringInput("INZ")
replace = String.Replace(string=name, searchFor=string, replaceWith=string_2)
setName = Custom[Element.SetName](element=filterByBoolMask.in, name=replace)  # package Clockwork for Dynamo 2.x; Gets the name of a given Revit element
