# Dynamo graph Get_ViewFilters_InDynamo.dyn (Dynamo 2.13.1.3887)
# packages: Clockwork for Dynamo 2.x 2.6.0

views = Views("_INZ_Abertura Detalle 1-10")
filters = View.Filters(view=views)
watch = Watch(filters)
name = Element.Name(element=filters)
watch_2 = Watch(name)
string = StringInput("ED")
string_2 = StringInput("INZ")
replace = String.Replace(string=name, searchFor=string, replaceWith=string_2)
watch_3 = Watch(replace)
setName = Custom[Element.SetName](element=name, name=replace)  # package Clockwork for Dynamo 2.x; Gets the name of a given Revit element
