# Dynamo graph DeleteParam.dyn (Dynamo 2.3.0.5885)
# packages: Orchid 230.0.3.7536

string = StringInput("TestFile1")
directory_path = Directory("No file selected.")
directory_from_path = DirectoryObject(path=directory_path)
string_from_object = FromObject(obj=directory_from_path)
# note: Make sure to add source path
python_script = Python(IN[0]=string, IN[1]=string_from_object)
# ---------- python_script.python (16 lines) ----------
import os
import shutil
import getpass

username = getpass.getuser()
fileName = IN[0]
destination = IN[1]
# Source path 
source = 

# Destination path
destination = destination + '\\' + fileName + '.rfa'
 
dest = shutil.copyfile(source, destination) 
  
OUT = destination
# ----------------------------------------
# note: Orchid - 230.0.3.7536
loadFamily = Orchid.RevitProject.Common.Document.LoadFamily(family=python_script)
edit = Orchid.RevitProject.Elements.Family.Edit(family=loadFamily)
code_block = CodeBlock { ["Param3", "Param5", "Param6_i"]; }
delete = Orchid.RevitFamily.Parameter.Delete(familyDocument=edit, parameterName=code_block@L1, lacing=Longest)
code_block_2 = CodeBlock(pass=edit, wait=delete) { [pass,wait][0]; }
code_block_3 = CodeBlock { true; }
close = Orchid.RevitProject.Common.Document.Close(document=code_block_2, save=code_block_3)
code_block_4 = CodeBlock(pass=python_script, wait=close) { [pass,wait][0]; }
loadFamily_2 = Orchid.RevitProject.Common.Document.LoadFamily(family=code_block_4)
