# Dynamo graph 11-Auto View and sheets generation.dyn (Dynamo 2.16.2.5624)

categories = Categories("OST_Levels")
all_elements_of_category = ElementsOfCategory(Category=categories)
name = Level.Name(level=all_elements_of_category)

# group: Sheet Floor Plan Name
etiqueta_posterior_sheet_floor = StringInput(" - Planta Innza")  # "Etiqueta Posterior Sheet Floor Plan"; graph input
add = name + etiqueta_posterior_sheet_floor

# group: Sheet Ceilling Plan Name
etiqueta_posterior_sheet = StringInput(" - Prueba Innza")  # "Etiqueta Posterior Sheet Ceilling"; graph input
add_2 = name + etiqueta_posterior_sheet

list_create = List.Create(item0=add, item1=add_2)

# group: Create Floor Plan Sheet Numbers
prefijo_nomensclatura_sheets = StringInput("FL - ")  # "Prefijo Nomensclatura Sheets Floors"; graph input
code_block = CodeBlock { 101; }
count = List.Count(list=name)
code_block_2 = CodeBlock { 1; }
sequence = Sequence(start=code_block, amount=count, step=code_block_2)
add_3 = prefijo_nomensclatura_sheets + sequence

# group: Create Ceilling Plan Sheet Numbers
prefijo_nomensclatura_sheets_2 = StringInput("CL - ")  # "Prefijo Nomensclatura Sheets Ceilling"; graph input
code_block_3 = CodeBlock { 101; }
count_2 = List.Count(list=name)
code_block_4 = CodeBlock { 1; }
sequence_2 = Sequence(start=code_block_3, amount=count_2, step=code_block_4)
add_4 = prefijo_nomensclatura_sheets_2 + sequence_2

list_create_2 = List.Create(item0=add_3, item1=add_4)
string_from_object = FromObject(object=list_create_2)
rotulo_de_laminas_a_usar = FamilyTypes("_INNZA_Rótulo 2023:A0 Horizontal")  # graph input

# group: Create Floor Plan
byLevel = FloorPlanView.ByLevel(level=all_elements_of_category)
code_block_5 = CodeBlock()
# ---------- code_block_5.designscript (2 lines) ----------
"View Name";
//Asegurarse que Revit este en idioma ENU
# ----------------------------------------
etiqueta_posterior_floor_plan = StringInput(" - Planta Innza")  # graph input
add_5 = name + etiqueta_posterior_floor_plan
setParameterByName = Element.SetParameterByName(element=byLevel, parameterName=code_block_5, value=add_5)

# group: Create Celling Plan
byLevel_2 = CeilingPlanView.ByLevel(level=all_elements_of_category)
etiqueta_posterior_ceilling_plan = StringInput(" - Ceilling Plan Innza")  # graph input
add_6 = name + etiqueta_posterior_ceilling_plan
setParameterByName_2 = Element.SetParameterByName(element=byLevel_2, parameterName=code_block_5, value=add_6)

list_create_3 = List.Create(item0=setParameterByName, item1=setParameterByName_2)
byNameNumberTitleBlockAndView = Sheet.ByNameNumberTitleBlockAndView(sheetName=list_create, sheetNumber=string_from_object, titleBlockFamilyType=rotulo_de_laminas_a_usar, view=list_create_3)
