# Dynamo graph 12_Auto_Dimension.dyn (Dynamo 2.16.2.5624)

current = Document.Current()
activeView = Document.ActiveView(document=current)
select_model_elements_by = DSModelElementsByCategorySelection("OST_Walls")  # "Select Model Elements By Category"; 9 picked in the model
getLocation = Element.GetLocation(element=select_model_elements_by)
number_slider = DoubleSlider(-0.2, range=-0.2..1.2 step 0.1)
pointAtParameter = Curve.PointAtParameter(curve=getLocation, param=number_slider)
byBestFitThroughPoints = Line.ByBestFitThroughPoints(bestFitPoints=pointAtParameter)
byElements = Dimension.ByElements(view=activeView, referenceElements=select_model_elements_by, line=byBestFitThroughPoints)
