# Dynamo graph 13-Warnings_Highlight.dyn "ABG_190911_Warnings-Highlight" (Dynamo 2.16.2.5624)
# packages: archi-lab.net 2023.213.1722

all_elements_in_active_view = ElementsInView()
getWarnings = archilab.Revit.Elements.Warning.GetWarnings()
elements = archilab.Revit.Elements.Warning.Elements(warning=getWarnings)
id = archilab.Revit.Elements.WarningElement.Id(warningElement=elements)
flatten = List.Flatten(list=id)
uniqueItems = List.UniqueItems(list=flatten)
id_2 = Element.Id(element=all_elements_in_active_view)
contains = List.Contains(list=uniqueItems@L2, item=id_2, lacing=Longest)
filterByBoolMask = List.FilterByBoolMask(list=all_elements_in_active_view, mask=contains)
code_block = CodeBlock { 255; 125; 0; }
byARGB = Color.ByARGB(alpha=code_block.out0, red=code_block.out0, green=code_block.out1, blue=code_block.out2)
byARGB_2 = Color.ByARGB(alpha=code_block.out0, red=code_block.out0, green=code_block.out0, blue=code_block.out2)
fill_patterns = FillPatterns("<Solid fill>")
byProperties = Revit.Filter.OverrideGraphicSettings.ByProperties(projectionFillColor=byARGB, projectionLineColor=byARGB_2, projectionFillPattern=fill_patterns)
overrideInView = Element.OverrideInView(element=filterByBoolMask.in, overrides=byProperties)
code_block_2 = CodeBlock { 255; 125; 0; }
byARGB_3 = Color.ByARGB(alpha=code_block_2.out0, red=code_block_2.out0, green=code_block_2.out0, blue=code_block_2.out0)
byARGB_4 = Color.ByARGB(alpha=code_block_2.out0, red=code_block_2.out1, green=code_block_2.out1, blue=code_block_2.out1)
fill_patterns_2 = FillPatterns("<Solid fill>")
code_block_3 = CodeBlock { 100; }
boolean = BoolSelector(true)
byProperties_2 = Revit.Filter.OverrideGraphicSettings.ByProperties(projectionFillColor=byARGB_3, projectionLineColor=byARGB_4, projectionFillPattern=fill_patterns_2, transparency=code_block_3, halftone=boolean)
overrideInView_2 = Element.OverrideInView(element=filterByBoolMask.out, overrides=byProperties_2)
