# Dynamo graph 13.2-Warnings_Reset_Views.dyn "14-Warnings_Reset_Views" (Dynamo 2.13.1.3887)
# packages: Clockwork for Dynamo 2.x 2.3.0

all_elements_in_active_view = ElementsInView()
current = Document.Current()
activeView = Document.ActiveView(document=current)
resetElementOverrides = Custom[View.ResetElementOverrides](element=all_elements_in_active_view, view=activeView)  # package Clockwork for Dynamo 2.x; Resets all overrides for an element in a given view
