# Dynamo graph Bulk_Join.dyn (Dynamo 2.13.1.3887)

categoria_elemento_principal = Categories()  # nothing selected
all_elements_of_category = ElementsOfCategory(Category=categoria_elemento_principal)
categoria_elemento_secundario_a = Categories()  # "Categoria Elemento Secundario (a cortar)"; nothing selected
all_elements_of_category_2 = ElementsOfCategory(Category=categoria_elemento_secundario_a)
joinGeometry = Element.JoinGeometry(element=all_elements_of_category, otherElement=all_elements_of_category_2, lacing=CrossProduct)
setGeometryJoinOrder = Element.SetGeometryJoinOrder(cuttingElement=all_elements_of_category, otherElement=all_elements_of_category_2, lacing=CrossProduct)
