# Dynamo graph Bulk_Join_CLOCKWORK.dyn (Dynamo 2.16.2.5624)
# packages: Clockwork for Dynamo 2.x 2.3.0, GenerativeDesign.Revit 3.0.18.0

select_family_instance = DSModelFamilyInstanceSelection()  # 1 picked in the model
elementType = Custom[Element.ElementType+](element=select_family_instance)  # package Clockwork for Dynamo 2.x; Gets the family type of a given element (if applicable). Unlike the OOTB node, it also works for elements in linked models.
all_elements_of_family_type = ElementsOfFamilyType(Family_Type=elementType)
select_family_instance_2 = DSModelFamilyInstanceSelection()  # 1 picked in the model
elementType_2 = Custom[Element.ElementType+](element=select_family_instance_2)
all_elements_of_family_type_2 = ElementsOfFamilyType(Family_Type=elementType_2)
joinGeometry = Custom[Element.JoinGeometry](element1=all_elements_of_family_type, element2=all_elements_of_family_type_2, lacing=CrossProduct)  # package Clockwork for Dynamo 2.x; Joins two model elements (if possible). Only works inside the project environment.
watch = Watch(joinGeometry.success)
watch_2 = Watch(all_elements_of_family_type_2)
watch_3 = Watch(all_elements_of_family_type)
cutGeometry = Custom[Element.CutGeometry](elementToBeCut=all_elements_of_family_type, cuttingElement=all_elements_of_family_type_2)  # frozen; package Clockwork for Dynamo 2.x; Adds a solid-solid cut for two model elements (if possible).
watch_4 = Watch(cutGeometry.success)
