# Dynamo graph Bulk_Join_FamilyType_Categories.dyn (Dynamo 2.13.1.3887)

family_types = FamilyTypes("INZ_Viga Hº Aº:150 x 450mm")
all_elements_of_family_type = ElementsOfFamilyType(Family_Type=family_types)
categoria_elemento_secundario_a = Categories("OST_StructuralColumns")  # "Categoria Elemento Secundario (a cortar)"; graph input
all_elements_of_category = ElementsOfCategory(Category=categoria_elemento_secundario_a)
joinGeometry = Element.JoinGeometry(element=all_elements_of_family_type, otherElement=all_elements_of_category, lacing=CrossProduct)
setGeometryJoinOrder = Element.SetGeometryJoinOrder(cuttingElement=all_elements_of_family_type, otherElement=all_elements_of_category, lacing=CrossProduct)  # frozen
watch = Watch(all_elements_of_family_type)
watch_2 = Watch(all_elements_of_category)
