# Dynamo graph 15-MEP_CAD.dyn "Caños prueba" (Dynamo 2.16.2.5624)
# packages: bimorphNodes 5.1.3, MEPover 2024.9.25, archi-lab.net 2023.213.1722

select_model_element = DSModelElementSelection()  # 1 picked in the model
curvesFromCADLayers = CAD.CurvesFromCADLayers(importInstance=select_model_element)
categories = Categories("OST_PipeCurves")
all_elements_of_category = ElementsOfCategory(Category=categories)
type = archilab.Revit.Elements.Elements.Type(element=all_elements_of_category)
categories_2 = Categories("OST_PipingSystem")
all_elements_of_category_2 = ElementsOfCategory(Category=categories_2)
type_2 = archilab.Revit.Elements.Elements.Type(element=all_elements_of_category_2)
levels = Levels("Level 1")
code_block = CodeBlock { 15.24; }
byLines = Custom[Pipe.ByLines](Lines=curvesFromCADLayers.Curve, PipeType=type, SystemType=type_2, level=levels, Diameter=code_block, lacing=Longest)  # package MEPover; Creates a pipe by Line, PipeType, SystemType, Level and Diameter
