# Dynamo graph 15-MEP_CAD_SELECT_PIPES.dyn (Dynamo 2.16.2.5624)
# packages: bimorphNodes 5.1.3, MEPover 2024.9.25, archi-lab.net 2023.213.1722

select_model_element = DSModelElementSelection()  # 1 picked in the model
curvesFromCADLayers = CAD.CurvesFromCADLayers(importInstance=select_model_element)
select_model_element_2 = DSModelElementSelection()  # 1 picked in the model
type = archilab.Revit.Elements.Elements.Type(element=select_model_element_2)
categories = Categories("OST_PipingSystem")
all_elements_of_category = ElementsOfCategory(Category=categories)
integer_slider = IntegerSlider(1, range=0..2 step 1)
getItemAtIndex = List.GetItemAtIndex(list=all_elements_of_category, index=integer_slider)
type_2 = archilab.Revit.Elements.Elements.Type(element=getItemAtIndex)
levels = Levels("Level 1")
code_block = CodeBlock { 11; }
byLines = Custom[Pipe.ByLines](Lines=curvesFromCADLayers.Curve, PipeType=type, SystemType=type_2, level=levels, Diameter=code_block, lacing=Longest)  # package MEPover; Creates a pipe by Line, PipeType, SystemType, Level and Diameter
select_model_element_3 = DSModelElementSelection()  # 1 picked in the model
curvesFromCADLayers_2 = CAD.CurvesFromCADLayers(importInstance=select_model_element_3)
select_model_element_4 = DSModelElementSelection()  # 1 picked in the model
type_3 = archilab.Revit.Elements.Elements.Type(element=select_model_element_4)
categories_2 = Categories("OST_PipingSystem")
all_elements_of_category_2 = ElementsOfCategory(Category=categories_2)
integer_slider_2 = IntegerSlider(0, range=0..2 step 1)
getItemAtIndex_2 = List.GetItemAtIndex(list=all_elements_of_category_2, index=integer_slider_2)
type_4 = archilab.Revit.Elements.Elements.Type(element=getItemAtIndex_2)
levels_2 = Levels("Level 1")
code_block_2 = CodeBlock { 11; }
byLines_2 = Custom[Pipe.ByLines](Lines=curvesFromCADLayers_2.Curve, PipeType=type_3, SystemType=type_4, level=levels_2, Diameter=code_block_2, lacing=Longest)
select_model_element_5 = DSModelElementSelection()  # 1 picked in the model
string = StringInput("0")
curvesFromCADLayers_3 = CAD.CurvesFromCADLayers(importInstance=select_model_element_5, layerNames=string)
select_model_element_6 = DSModelElementSelection()  # 1 picked in the model
type_5 = archilab.Revit.Elements.Elements.Type(element=select_model_element_6)
categories_3 = Categories("OST_PipingSystem")
all_elements_of_category_3 = ElementsOfCategory(Category=categories_3)
integer_slider_3 = IntegerSlider(0, range=0..2 step 1)
getItemAtIndex_3 = List.GetItemAtIndex(list=all_elements_of_category_3, index=integer_slider_3)
type_6 = archilab.Revit.Elements.Elements.Type(element=getItemAtIndex_3)
levels_3 = Levels("Level 1")
code_block_3 = CodeBlock { 11; }
byLines_3 = Custom[Pipe.ByLines](Lines=curvesFromCADLayers_3.Curve, PipeType=type_5, SystemType=type_6, level=levels_3, Diameter=code_block_3, lacing=Longest)
select_model_element_7 = DSModelElementSelection()  # 1 picked in the model
string_2 = StringInput("1")
curvesFromCADLayers_4 = CAD.CurvesFromCADLayers(importInstance=select_model_element_7, layerNames=string_2)
select_model_element_8 = DSModelElementSelection()  # 1 picked in the model
type_7 = archilab.Revit.Elements.Elements.Type(element=select_model_element_8)
select_model_element_9 = DSModelElementSelection()  # 1 picked in the model
systemType = Custom[Element.SystemType](element=select_model_element_9)  # package MEPover; Returns the mechanical or plumbing System Type
levels_4 = Levels("Level 1")
code_block_4 = CodeBlock { 11; }
byLines_4 = Custom[Pipe.ByLines](Lines=curvesFromCADLayers_4.Curve, PipeType=type_7, SystemType=systemType, level=levels_4, Diameter=code_block_4, lacing=Longest)
