# Dynamo graph 15.1-MEP_CAD_SELECT_PIPES.dyn "15-MEP_CAD_SELECT_PIPES" (Dynamo 2.13.1.3887)
# packages: bimorphNodes 5.1.3, MEPover 2024.9.25, archi-lab.net 2023.213.1722

seleccionar_cad = DSModelElementSelection()  # 1 picked in the model; graph input
nombre_de_capa_del_cad = StringInput("0")  # graph input
curvesFromCADLayers = CAD.CurvesFromCADLayers(importInstance=seleccionar_cad, layerNames=nombre_de_capa_del_cad)
seleccionar_tipo_de_caño_con = DSModelElementSelection()  # "Seleccionar tipo de caño (con System Type correcto)"; 1 picked in the model; graph input
type = archilab.Revit.Elements.Elements.Type(element=seleccionar_tipo_de_caño_con)
systemType = Custom[Element.SystemType](element=seleccionar_tipo_de_caño_con)  # package MEPover; Returns the mechanical or plumbing System Type
nivel_al_que_esta_referenciado = Levels("Level 2")  # "Nivel al que esta referenciado el caño"; graph input
diámetro_del_caño_tiene_que_ser = DoubleInput(11)  # "Diámetro del caño (Tiene que ser uno existente en la familia)."; graph input
byLines = Custom[Pipe.ByLines](Lines=curvesFromCADLayers.Curve, PipeType=type, SystemType=systemType, level=nivel_al_que_esta_referenciado, Diameter=diámetro_del_caño_tiene_que_ser, lacing=Longest)  # package MEPover; Creates a pipe by Line, PipeType, SystemType, Level and Diameter
