# Dynamo graph 15.3-MEP_CAD_PIPES_JOIN_TEE.dyn (Dynamo 2.13.1.3887)
# packages: MEPover 2024.9.25

categories = Categories("OST_PipeCurves")
all_elements_of_category = ElementsOfCategory(Category=categories)
margen_de_union = DoubleInput(1)  # graph input
byMEPCurves = Custom[Elbow.ByMEPCurves](MEPCurves=all_elements_of_category, Margin=margen_de_union)  # package MEPover; Takes in a list of MEPCurves (pipe, duct, cable tray, conduit) and will attempt to create elbows where possible. A margin can be entered for max distance between connectors
by2MEPCurves = Custom[Tee.By2MEPCurves]()  # package MEPover; Creates a tee by a main curve and a branch MEP curve (duct, pipe, conduit, cable tray). Only works with perpendicular brand curves; unwired: Main_MEPCurve, Branch_MEPCurve
