# Dynamo graph 16-WALLS_CAD.dyn (Dynamo 2.16.2.5624)
# packages: bimorphNodes 5.1.3, archi-lab.net 2023.213.1722

selecciona_cad = DSModelElementSelection()  # 1 picked in the model; graph input
nombre_de_capa_en_cad = StringInput("0")  # graph input
curvesFromCADLayers = CAD.CurvesFromCADLayers(importInstance=selecciona_cad, layerNames=nombre_de_capa_en_cad)
flatten = List.Flatten(list=curvesFromCADLayers.Curve)
start_level = Levels("Level 1")  # graph input
end_level = Levels("Level 2")  # graph input
wall_type = WallTypes("Generic - 8\"")  # graph input
byCurveAndLevels = Wall.ByCurveAndLevels(curve=flatten, startLevel=start_level, endLevel=end_level, wallType=wall_type)
categories = Categories("OST_Walls")
all_elements_of_category = ElementsOfCategory(Category=categories)
passThrough = Custom[PassThrough](passThrough=all_elements_of_category)  # package archi-lab.net; Ripped this off from Clockwork. Sorry Andy.; unwired: waitFor
