# Dynamo graph 16-WALLS_CAD_Parallels_Lines.dyn (Dynamo 2.16.2.5624)
# packages: archi-lab.net 2023.213.1722, spring nodes 210.1.1, Genius Loci 2024.5.29, bimorphNodes 5.1.3

start_level = Levels("Level 1")  # graph input
end_level = Levels("Level 2")  # graph input
wall_type = WallTypes("Generic - 8\"")  # graph input
byCurveAndLevels = Wall.ByCurveAndLevels(startLevel=start_level, endLevel=end_level, wallType=wall_type)  # unwired: curve
categories = Categories("OST_Walls")
all_elements_of_category = ElementsOfCategory(Category=categories)
passThrough = Custom[PassThrough](passThrough=all_elements_of_category)  # package archi-lab.net; Ripped this off from Clockwork. Sorry Andy.; unwired: waitFor

# group: Lineas del CAD
selecciona_cad = DSModelElementSelection()  # 1 picked in the model; graph input
nombre_de_capa_en_cad = StringInput("0")  # graph input
curvesFromCADLayers = CAD.CurvesFromCADLayers(importInstance=selecciona_cad, layerNames=nombre_de_capa_en_cad)
flatten = List.Flatten(list=curvesFromCADLayers.Curve)

# group: Agrupar lineas paralelas cercanas
group_parallel_lines = Custom[Group Parallel Lines](lines=flatten)  # package Genius Loci; Groups parallel lines or linear elements together.
number_slider = DoubleSlider(30, range=10..200 step 10)
ꟿ_geometry_groupbydistance = Custom[ꟿ Geometry.GroupByDistance](geometry=group_parallel_lines, margin=number_slider)  # package spring nodes; Splits the list of geometry elements into groups if the distance between them is less than the provided margin.
