# Dynamo graph 16.1-WALLS_CAD_Level_Restrictions.dyn (Dynamo 2.13.1.3887)
# packages: bimorphNodes 5.1.3, Genius Loci 2024.5.29

selecciona_cad = DSModelElementSelection()  # 1 picked in the model; graph input
nombre_de_capa_en_cad = StringInput("0")  # graph input
curvesFromCADLayers = CAD.CurvesFromCADLayers(importInstance=selecciona_cad, layerNames=nombre_de_capa_en_cad)
flatten = List.Flatten(list=curvesFromCADLayers.Curve)
start_level = Levels("Level 1")  # graph input
end_level = Levels("Level 2")  # graph input
code_block = CodeBlock(l1=start_level, l2=end_level) { z1 = l1.Elevation; z2 = l2.Elevation; dist = z2 - z1; }
wall_type = WallTypes("Interior - Blockwork 100")  # graph input
wall_location = WallLocation("WallCenterline")  # graph input
es_estructural = BoolSelector(false)  # graph input
wall_bycurveandlevel = Custom[Wall ByCurveAndLevel](curve=flatten, Height=code_block.dist, level=start_level, wallType=wall_type, WallLocation=wall_location, IsStructural=es_estructural)  # package Genius Loci; Creates a wall using the specified guiding curve and level.
nombre_de_parámetro_top = StringInput("Top Constraint")  # "Nombre de parámetro Top Constraint en el idioma elegido. Si estamos en Revit en ingles dejar así."; graph input
setParameterByName = Element.SetParameterByName(element=wall_bycurveandlevel, parameterName=nombre_de_parámetro_top, value=end_level)
