# Dynamo graph 16.2-WALLS_CAD_Custom_Height.dyn (Dynamo 2.13.1.3887)
# packages: bimorphNodes 5.1.3, Genius Loci 2024.5.29

selecciona_cad = DSModelElementSelection()  # 1 picked in the model; graph input
nombre_de_capa_en_cad = StringInput("0")  # graph input
curvesFromCADLayers = CAD.CurvesFromCADLayers(importInstance=selecciona_cad, layerNames=nombre_de_capa_en_cad)
flatten = List.Flatten(list=curvesFromCADLayers.Curve)
altura_del_muro = DoubleInput(100)  # graph input
start_level = Levels("Level 1")  # graph input
wall_type = WallTypes("Interior - Blockwork 100")  # graph input
wall_location = WallLocation("WallCenterline")  # graph input
es_estructural = BoolSelector(false)  # graph input
wall_bycurveandlevel = Custom[Wall ByCurveAndLevel](curve=flatten, Height=altura_del_muro, level=start_level, wallType=wall_type, WallLocation=wall_location, IsStructural=es_estructural)  # package Genius Loci; Creates a wall using the specified guiding curve and level.
