# Dynamo graph 16.3-WALLS_CAD_Parallels_Lines.dyn "16-WALLS_CAD_Parallels_Lines" (Dynamo 2.13.1.3887)
# packages: spring nodes 210.1.1, Genius Loci 2024.5.29, bimorphNodes 5.1.3

# group: Lineas del CAD
selecciona_cad = DSModelElementSelection()  # 1 picked in the model; graph input
nombre_de_capa_en_cad = StringInput("0")  # graph input
curvesFromCADLayers = CAD.CurvesFromCADLayers(importInstance=selecciona_cad, layerNames=nombre_de_capa_en_cad)
flatten = List.Flatten(list=curvesFromCADLayers.Curve)

# group: Agrupar lineas paralelas cercanas
group_parallel_lines = Custom[Group Parallel Lines](lines=flatten)  # package Genius Loci
number_slider = DoubleSlider(30, range=0..500 step 100)
ꟿ_geometry_groupbydistance = Custom[ꟿ Geometry.GroupByDistance](geometry=group_parallel_lines, margin=number_slider)  # package spring nodes

# group: Filtro de listas
length = Curve.Length(curve=ꟿ_geometry_groupbydistance)
maximumItem = List.MaximumItem(list=length@L3)
number_slider_2 = DoubleSlider(1, range=0..2 step 1)
chop = List.Chop(list=maximumItem@L2, lengths=number_slider_2)
indexOf = List.IndexOf(list=length@L2, element=chop@L1)

# group: Wall Parameters
getItemAtIndex = List.GetItemAtIndex(list=ꟿ_geometry_groupbydistance@L2, index=indexOf@L1)
code_block = CodeBlock { 3000; }
start_level = Levels("Level 1")  # graph input
wall_type = WallTypes("Generic - 200mm")  # graph input
wall_location = WallLocation("CoreCenterline")
wall_bycurveandlevel = Custom[Wall ByCurveAndLevel](curve=getItemAtIndex, Height=code_block, level=start_level, wallType=wall_type, WallLocation=wall_location)  # package Genius Loci; Creates a wall using the specified guiding curve and level.
geometry = Element.Geometry(element=wall_bycurveandlevel)
