# Dynamo graph 16.4-WALLS_CAD_Parallels_Lines_2.dyn "16.3-WALLS_CAD_Parallels_Lines_2" (Dynamo 2.13.1.3887)
# packages: bimorphNodes 5.1.3, spring nodes 210.1.1, Genius Loci 2024.5.29

# group: Lineas del CAD
selecciona_cad = DSModelElementSelection()  # 1 picked in the model; graph input
nombre_de_capa_en_cad = StringInput("0")  # graph input
curvesFromCADLayers = CAD.CurvesFromCADLayers(importInstance=selecciona_cad, layerNames=nombre_de_capa_en_cad)
flatten = List.Flatten(list=curvesFromCADLayers.Curve)

length = Curve.Length(curve=flatten)
espesor_del_muro_máximo = DoubleSlider(200, range=0..500 step 50)
code_block = CodeBlock(A=espesor_del_muro_máximo) { A*1.2; }
gt = length > code_block
filterByBoolMask = List.FilterByBoolMask(list=curvesFromCADLayers.Curve, mask=gt)
code_block_2 = CodeBlock { 0.5; }
pointAtParameter = Curve.PointAtParameter(curve=filterByBoolMask.in, param=code_block_2)
ꟿ_geometry_groupbydistance = Custom[ꟿ Geometry.GroupByDistance](geometry=pointAtParameter, margin=code_block)  # package spring nodes; Splits the list of geometry elements into groups if the distance between them is less than the provided margin.
indexOf = List.IndexOf(list=pointAtParameter@L2, element=ꟿ_geometry_groupbydistance)
getItemAtIndex = List.GetItemAtIndex(list=filterByBoolMask.in@L2, index=indexOf@L3)
byLoft = Surface.ByLoft(crossSections=getItemAtIndex@L3)
code_block_3 = CodeBlock { 0; 0.5; }
getIsoline = Surface.GetIsoline(surface=byLoft@L3, isoDirection=code_block_3.out0, parameter=code_block_3.out1)

# group: Wall Parameters
code_block_4 = CodeBlock { 3000; }
start_level = Levels("Level 1")  # graph input
wall_type = WallTypes("Generic - 200mm")  # graph input
wall_location = WallLocation("WallCenterline")
wall_bycurveandlevel = Custom[Wall ByCurveAndLevel](curve=getIsoline@L1, Height=code_block_4, level=start_level, wallType=wall_type, WallLocation=wall_location)  # package Genius Loci; Creates a wall using the specified guiding curve and level.
