# Dynamo graph 16.5-WALLS_CAD_Parallels_Lines_Ortogonal.dyn (Dynamo 2.13.1.3887)
# packages: bimorphNodes 5.1.3, spring nodes 210.1.1, Chynamo 0.8.5, Genius Loci 2024.5.29

# group: Lineas del CAD
selecciona_cad = DSModelElementSelection()  # 1 picked in the model; graph input
nombre_de_capa_en_cad = StringInput("K-MUROS")  # graph input
curvesFromCADLayers = CAD.CurvesFromCADLayers(importInstance=selecciona_cad, layerNames=nombre_de_capa_en_cad)

length = Curve.Length(curve=curvesFromCADLayers.Curve)
espesor_del_muro_máximo = DoubleSlider(100, range=0..500 step 50)
gt = length > espesor_del_muro_máximo
filterByBoolMask = List.FilterByBoolMask(list=curvesFromCADLayers.Curve, mask=gt)
groupByParallel = Custom[GroupByParallel](lines=filterByBoolMask.in)  # package Chynamo; Group lines if they are parallel
code_block = CodeBlock(A=espesor_del_muro_máximo) { A*1.2; }
ꟿ_geometry_groupbydistance = Custom[ꟿ Geometry.GroupByDistance](geometry=groupByParallel, margin=code_block)  # package spring nodes; Splits the list of geometry elements into groups if the distance between them is less than the provided margin.
count = List.Count(list=ꟿ_geometry_groupbydistance@@L2)
code_block_2 = CodeBlock { 1; }
gt_2 = count > code_block_2
filterByBoolMask_2 = List.FilterByBoolMask(list=ꟿ_geometry_groupbydistance, mask=gt_2)
byGeometry = BoundingBox.ByGeometry(geom=filterByBoolMask_2.in)
toCuboid = BoundingBox.ToCuboid(boundingBox=byGeometry)
XY = Plane.XY()
intersect = Geometry.Intersect(geometry=toCuboid, other=XY)
flatten = List.Flatten(list=intersect)
code_block_3 = CodeBlock { 0.5; 0; 1; }
getIsoline = Surface.GetIsoline(surface=flatten, isoDirection=code_block_3.out1, parameter=code_block_3.out0)
length_2 = Curve.Length(curve=getIsoline)
getIsoline_2 = Surface.GetIsoline(surface=flatten, isoDirection=code_block_3.out2, parameter=code_block_3.out0)
length_3 = Curve.Length(curve=getIsoline_2)
gt_3 = length_2 > length_3
filterByBoolMask_3 = List.FilterByBoolMask(list=getIsoline, mask=gt_3)
filterByBoolMask_4 = List.FilterByBoolMask(list=getIsoline_2, mask=gt_3)
list_create = List.Create(item0=filterByBoolMask_3.in, item1=filterByBoolMask_4.in)
start_level = Levels("Level 1")  # graph input
start_level_2 = Levels("Level 2")  # graph input
wall_type = WallTypes("Generic - 140mm Masonry")  # graph input
byCurveAndLevels = Wall.ByCurveAndLevels(curve=list_create, startLevel=start_level, endLevel=start_level_2, wallType=wall_type, lacing=Longest)
group_parallel_lines = Custom[Group Parallel Lines](lines=curvesFromCADLayers.Curve@L2)  # package Genius Loci; Groups parallel lines or linear elements together.
