# Dynamo graph 17.1-BEAM_CAD_ByLevel.dyn (Dynamo 2.16.2.5624)
# packages: bimorphNodes 5.1.3, archi-lab.net 2023.213.1722

selecciona_cad = DSModelElementSelection()  # 1 picked in the model; graph input
nombre_de_capa_en_cad = StringInput("1")  # graph input
curvesFromCADLayers = CAD.CurvesFromCADLayers(importInstance=selecciona_cad, layerNames=nombre_de_capa_en_cad)
flatten = List.Flatten(list=curvesFromCADLayers.Curve)
structural_framing_types = StructuralFramingTypes("W12X26")  # graph input
reference_level = Levels("Level 2")  # graph input
beamByCurve = Custom[StructuralFraming.BeamByCurve](curve=flatten@L2, structuralFramingType=structural_framing_types, level=reference_level)  # package archi-lab.net; This node will take an input of curves and attempt to make a structural framing member by type and level.
nombre_de_parámetro_reference = StringInput("Reference Level")  # "Nombre de parámetro Reference Level en el idioma elegido. Si estamos en Revit en ingles dejar así."; graph input
setParameterByName = Element.SetParameterByName(element=beamByCurve, parameterName=nombre_de_parámetro_reference, value=reference_level)
