# Dynamo graph 18.1-COLUMNS_CAD_ByLevel.dyn (Dynamo 2.16.2.5624)
# packages: bimorphNodes 5.1.3, KYSUDO.com 21.0.8, archi-lab.net 2023.213.1722

structural_column_types = StructuralColumnTypes("24 x 30")
selecciona_cad = DSModelElementSelection()  # 1 picked in the model; graph input
nombre_de_capa_en_cad = StringInput("1")  # graph input
curvesFromCADLayers = CAD.CurvesFromCADLayers(importInstance=selecciona_cad, layerNames=nombre_de_capa_en_cad)
flatten = List.Flatten(list=curvesFromCADLayers.Curve)
byJoinedCurves = PolyCurve.ByJoinedCurves(curves=flatten@L1)
toColumnGeometry = Custom[ToColumnGeometry](polyCurve=byJoinedCurves)  # package KYSUDO.com
levels = Levels("Level 1")
byPointAndLevel = FamilyInstance.ByPointAndLevel(familyType=structural_column_types, point=toColumnGeometry.Ins_Point, level=levels)
code_block = CodeBlock { 0.5; }
line_RoundXY = Custom[Line_RoundXY](line=flatten, number=code_block)  # package KYSUDO.com
group_curves = Custom[Group Curves](curves=line_RoundXY)  # package archi-lab.net; This node will take any input of flat list of curves and group them into sublists containing "joinable" curves that is continous curves. They might form closed curves or open curves. Use PolyCurve.ByJoinedCurves to convert output groups of curves into single PolyCurves
