# Dynamo graph 20.0-All_View_Halftone.dyn (Dynamo 2.13.1.3887)

all_elements_in_active_view = ElementsInView()

# group: Overrides
code_block = CodeBlock { 255; 125; 0; }
byARGB = Color.ByARGB(alpha=code_block.out0, red=code_block.out0, green=code_block.out0, blue=code_block.out0)
byARGB_2 = Color.ByARGB(alpha=code_block.out0, red=code_block.out1, green=code_block.out1, blue=code_block.out1)
fill_patterns = FillPatterns("<Solid fill>")
code_block_2 = CodeBlock { 100; }
boolean = BoolSelector(true)
byProperties = Revit.Filter.OverrideGraphicSettings.ByProperties(projectionFillColor=byARGB, projectionLineColor=byARGB_2, projectionFillPattern=fill_patterns, transparency=code_block_2, halftone=boolean)

overrideInView = Element.OverrideInView(element=all_elements_in_active_view, overrides=byProperties)
