# Dynamo graph 20.1-MEP_CorrectLevel_Check_Highlight_(Pipes+Accesories+Fittings).dyn "20.1-MEP_CorrectLevel_Check_Highlight" (Dynamo 2.13.1.3887)

# group: Obtener la altura del punto medio de los caños
categories = Categories("OST_PipeCurves")
all_elements_of_category = ElementsOfCategory(Category=categories)
nombre_del_parámetro_reference = StringInput("Reference Level")  # "Nombre del parámetro Reference level en idioma correcto (Pipes)"
getParameterValueByName = Element.GetParameterValueByName(element=all_elements_of_category, parameterName=nombre_del_parámetro_reference)
getLocation = Element.GetLocation(element=all_elements_of_category)
number_slider = DoubleSlider(0.5, range=0..1 step 0.5)
pointAtParameter = Curve.PointAtParameter(curve=getLocation, param=number_slider)
Z = Point.Z(point=pointAtParameter)

# group: Calculo diferencia de altura
elevation = Level.Elevation(level=getParameterValueByName)
sub = elevation - Z
abs = Math.Abs(number=sub)

# group: Filtrar los caños que no cumplen la condición
diferencia_de_nivel_máxima = DoubleInput(1.2)  # graph input
gt = abs > diferencia_de_nivel_máxima
filterByBoolMask = List.FilterByBoolMask(list=all_elements_of_category, mask=gt)

# group: Overrides
code_block = CodeBlock { 255; 125; 0; }
byARGB = Color.ByARGB(alpha=code_block.out0, red=code_block.out0, green=code_block.out1, blue=code_block.out2)
byARGB_2 = Color.ByARGB(alpha=code_block.out0, red=code_block.out0, green=code_block.out1, blue=code_block.out2)
fill_patterns = FillPatterns("<Solid fill>")
byProperties = Revit.Filter.OverrideGraphicSettings.ByProperties(projectionFillColor=byARGB, projectionLineColor=byARGB_2, projectionFillPattern=fill_patterns)
code_block_2 = CodeBlock { 255; 125; 0; }
byARGB_3 = Color.ByARGB(alpha=code_block_2.out0, red=code_block_2.out0, green=code_block_2.out0, blue=code_block_2.out0)
byARGB_4 = Color.ByARGB(alpha=code_block_2.out0, red=code_block_2.out1, green=code_block_2.out1, blue=code_block_2.out1)
fill_patterns_2 = FillPatterns("<Solid fill>")
code_block_3 = CodeBlock { 100; }
boolean = BoolSelector(true)
byProperties_2 = Revit.Filter.OverrideGraphicSettings.ByProperties(projectionFillColor=byARGB_3, projectionLineColor=byARGB_4, projectionFillPattern=fill_patterns_2, transparency=code_block_3, halftone=boolean)

# group: Obtener la altura
categories_2 = Categories("OST_PipeFitting")
all_elements_of_category_2 = ElementsOfCategory(Category=categories_2)
nombre_del_parámetro_level_o = StringInput("Level")  # "Nombre del parámetro Level o similar (Pipe Fittings)"; graph input
getParameterValueByName_2 = Element.GetParameterValueByName(element=all_elements_of_category_2, parameterName=nombre_del_parámetro_level_o)
getLocation_2 = Element.GetLocation(element=all_elements_of_category_2)
Z_2 = Point.Z(point=getLocation_2)

# group: Calculo diferencia de altura
elevation_2 = Level.Elevation(level=getParameterValueByName_2)
sub_2 = elevation_2 - Z_2
code_block_4 = CodeBlock { 0; }
code_block_5 = CodeBlock(inputList=sub_2, replacementValue=code_block_4) { inputList == null ? replacementValue : inputList; }
abs_2 = Math.Abs(number=code_block_5)

# group: Filtrar los caños que no cumplen la condición
diferencia_de_nivel_máxima_2 = DoubleInput(1.2)  # graph input
gt_2 = abs_2 > diferencia_de_nivel_máxima_2
filterByBoolMask_2 = List.FilterByBoolMask(list=all_elements_of_category_2, mask=gt_2)

# group: Obtener la altura
categories_3 = Categories("OST_PipeAccessory")
all_elements_of_category_3 = ElementsOfCategory(Category=categories_3)
nombre_del_parámetro_level_o_2 = StringInput("Level")  # "Nombre del parámetro Level o similar (Pipe accesories)"; graph input
getParameterValueByName_3 = Element.GetParameterValueByName(element=all_elements_of_category_3, parameterName=nombre_del_parámetro_level_o_2)
getLocation_3 = Element.GetLocation(element=all_elements_of_category_3)
Z_3 = Point.Z(point=getLocation_3)

# group: Calculo diferencia de altura
elevation_3 = Level.Elevation(level=getParameterValueByName_3)
sub_3 = elevation_3 - Z_3
code_block_6 = CodeBlock { 0; }
code_block_7 = CodeBlock(inputList=sub_3, replacementValue=code_block_6) { inputList == null ? replacementValue : inputList; }
abs_3 = Math.Abs(number=code_block_7)

# group: Filtrar los caños que no cumplen la condición
diferencia_de_nivel_máxima_3 = DoubleInput(1.2)  # graph input
gt_3 = abs_3 > diferencia_de_nivel_máxima_3
filterByBoolMask_3 = List.FilterByBoolMask(list=all_elements_of_category_3, mask=gt_3)

# group: Overrides aplied
overrideInView = Element.OverrideInView(element=filterByBoolMask.in, overrides=byProperties)
overrideInView_2 = Element.OverrideInView(element=filterByBoolMask.out, overrides=byProperties_2)
overrideInView_3 = Element.OverrideInView(element=filterByBoolMask_2.in, overrides=byProperties)
overrideInView_4 = Element.OverrideInView(element=filterByBoolMask_2.out, overrides=byProperties_2)
overrideInView_5 = Element.OverrideInView(element=filterByBoolMask_3.in, overrides=byProperties)
overrideInView_6 = Element.OverrideInView(element=filterByBoolMask_3.out, overrides=byProperties_2)
