# Dynamo graph 20.3.2-MEP_CorrectLevel_Check_Highlight_PipeAccesories.dyn "20.4-MEP_CorrectLevel_Check_Highlight_PipeAccesories" (Dynamo 2.13.1.3887)

# group: Obtener la altura
categories = Categories("OST_PipeAccessory")
all_elements_of_category = ElementsOfCategory(Category=categories)
nombre_del_parámetro_level_o = StringInput("Level")  # "Nombre del parámetro Level o similar"; graph input
getParameterValueByName = Element.GetParameterValueByName(element=all_elements_of_category, parameterName=nombre_del_parámetro_level_o)
getLocation = Element.GetLocation(element=all_elements_of_category)
Z = Point.Z(point=getLocation)

# group: Calculo diferencia de altura
elevation = Level.Elevation(level=getParameterValueByName)
sub = elevation - Z
code_block = CodeBlock { 0; }
code_block_2 = CodeBlock(inputList=sub, replacementValue=code_block) { inputList == null ? replacementValue : inputList; }
abs = Math.Abs(number=code_block_2)

# group: Filtrar los caños que no cumplen la condición
diferencia_de_nivel_máxima = DoubleInput(1.2)  # graph input
gt = abs > diferencia_de_nivel_máxima
filterByBoolMask = List.FilterByBoolMask(list=all_elements_of_category, mask=gt)

# group: Override graphics in view
code_block_3 = CodeBlock { 255; 125; 0; }
byARGB = Color.ByARGB(alpha=code_block_3.out0, red=code_block_3.out0, green=code_block_3.out1, blue=code_block_3.out2)
byARGB_2 = Color.ByARGB(alpha=code_block_3.out0, red=code_block_3.out0, green=code_block_3.out1, blue=code_block_3.out2)
fill_patterns = FillPatterns()  # nothing selected
byProperties = Revit.Filter.OverrideGraphicSettings.ByProperties(projectionFillColor=byARGB, projectionLineColor=byARGB_2, projectionFillPattern=fill_patterns)
overrideInView = Element.OverrideInView(element=filterByBoolMask.in, overrides=byProperties)
code_block_4 = CodeBlock { 255; 125; 0; }
byARGB_3 = Color.ByARGB(alpha=code_block_4.out0, red=code_block_4.out0, green=code_block_4.out0, blue=code_block_4.out0)
byARGB_4 = Color.ByARGB(alpha=code_block_4.out0, red=code_block_4.out1, green=code_block_4.out1, blue=code_block_4.out1)
fill_patterns_2 = FillPatterns()  # nothing selected
code_block_5 = CodeBlock { 100; }
boolean = BoolSelector(true)
byProperties_2 = Revit.Filter.OverrideGraphicSettings.ByProperties(projectionFillColor=byARGB_3, projectionLineColor=byARGB_4, projectionFillPattern=fill_patterns_2, transparency=code_block_5, halftone=boolean)
overrideInView_2 = Element.OverrideInView(element=filterByBoolMask.out, overrides=byProperties_2)
