# Dynamo graph 20.3.3-MEP_CorrectLevel_Check_Highlight_Pipes.dyn "20-MEP_CorrectLevel_Check" (Dynamo 2.13.1.3887)

# group: Obtener la altura del punto medio de los caños
categories = Categories("OST_PipeCurves")
all_elements_of_category = ElementsOfCategory(Category=categories)
string = StringInput("Reference Level")
getParameterValueByName = Element.GetParameterValueByName(element=all_elements_of_category, parameterName=string)
getLocation = Element.GetLocation(element=all_elements_of_category)
number_slider = DoubleSlider(0.5, range=0..1 step 0.5)
pointAtParameter = Curve.PointAtParameter(curve=getLocation, param=number_slider)
Z = Point.Z(point=pointAtParameter)

# group: Calculo diferencia de altura
elevation = Level.Elevation(level=getParameterValueByName)
sub = elevation - Z
abs = Math.Abs(number=sub)

# group: Filtrar los caños que no cumplen la condición
diferencia_de_nivel_máxima = DoubleInput(1.2)  # graph input
gt = abs > diferencia_de_nivel_máxima
filterByBoolMask = List.FilterByBoolMask(list=all_elements_of_category, mask=gt)

# group: Override graphics in view
code_block = CodeBlock { 255; 125; 0; }
byARGB = Color.ByARGB(alpha=code_block.out0, red=code_block.out0, green=code_block.out1, blue=code_block.out2)
byARGB_2 = Color.ByARGB(alpha=code_block.out0, red=code_block.out0, green=code_block.out1, blue=code_block.out2)
fill_patterns = FillPatterns("<Solid fill>")
byProperties = Revit.Filter.OverrideGraphicSettings.ByProperties(projectionFillColor=byARGB, projectionLineColor=byARGB_2, projectionFillPattern=fill_patterns)
overrideInView = Element.OverrideInView(element=filterByBoolMask.in, overrides=byProperties)
code_block_2 = CodeBlock { 255; 125; 0; }
byARGB_3 = Color.ByARGB(alpha=code_block_2.out0, red=code_block_2.out0, green=code_block_2.out0, blue=code_block_2.out0)
byARGB_4 = Color.ByARGB(alpha=code_block_2.out0, red=code_block_2.out1, green=code_block_2.out1, blue=code_block_2.out1)
fill_patterns_2 = FillPatterns("<Solid fill>")
code_block_3 = CodeBlock { 100; }
boolean = BoolSelector(true)
byProperties_2 = Revit.Filter.OverrideGraphicSettings.ByProperties(projectionFillColor=byARGB_3, projectionLineColor=byARGB_4, projectionFillPattern=fill_patterns_2, transparency=code_block_3, halftone=boolean)
overrideInView_2 = Element.OverrideInView(element=filterByBoolMask.out, overrides=byProperties_2)
