# Dynamo graph Steel framing Panel.dyn (Dynamo 2.13.1.3887)

number_slider = DoubleSlider(0, range=0..100 step 0.1)
number_slider_2 = DoubleSlider(0, range=0..100 step 0.1)
nivel_superior = Levels("Level 1")  # graph input
elevation = Level.Elevation(level=nivel_superior)
byCoordinates = Point.ByCoordinates(x=number_slider, y=number_slider_2, z=elevation)
largo_del_panel = DoubleSlider(15, range=0..2000 step 0.1)  # graph input
number_slider_3 = DoubleSlider(0, range=0..2000 step 0.1)
byCoordinates_2 = Point.ByCoordinates(x=largo_del_panel, y=number_slider_3, z=elevation)
byStartPointEndPoint = Line.ByStartPointEndPoint(startPoint=byCoordinates, endPoint=byCoordinates_2)
perfil_solera_superior = StructuralFramingTypes("UB305x165x40")  # graph input
beamByCurve = StructuralFraming.BeamByCurve(curve=byStartPointEndPoint, level=nivel_superior, structuralFramingType=perfil_solera_superior)
number_slider_4 = DoubleSlider(0, range=0..100 step 0.1)
number_slider_5 = DoubleSlider(0, range=0..100 step 0.1)
nivel_inferior = Levels("Level 0")  # graph input
elevation_2 = Level.Elevation(level=nivel_inferior)
byCoordinates_3 = Point.ByCoordinates(x=number_slider_4, y=number_slider_5, z=elevation_2)
number_slider_6 = DoubleSlider(0, range=0..2000 step 0.1)
byCoordinates_4 = Point.ByCoordinates(x=largo_del_panel, y=number_slider_6, z=elevation_2)
byStartPointEndPoint_2 = Line.ByStartPointEndPoint(startPoint=byCoordinates_3, endPoint=byCoordinates_4)
perfil_solera_inferior = StructuralFramingTypes("UB305x165x40")  # graph input
beamByCurve_2 = StructuralFraming.BeamByCurve(curve=byStartPointEndPoint_2, level=nivel_inferior, structuralFramingType=perfil_solera_inferior)
numero_de_montantes = IntegerSlider(4, range=0..100 step 1)  # graph input
pointsAtEqualChordLength = Curve.PointsAtEqualChordLength(curve=byStartPointEndPoint_2, divisions=numero_de_montantes)
pointsAtEqualChordLength_2 = Curve.PointsAtEqualChordLength(curve=byStartPointEndPoint, divisions=numero_de_montantes)
byStartPointEndPoint_3 = Line.ByStartPointEndPoint(startPoint=pointsAtEqualChordLength, endPoint=pointsAtEqualChordLength_2)
perfil_montantes_intermedios = StructuralFramingTypes("UB305x165x40")
beamByCurve_3 = StructuralFraming.BeamByCurve(curve=byStartPointEndPoint_3, level=nivel_inferior, structuralFramingType=perfil_montantes_intermedios)
byStartPointEndPoint_4 = Line.ByStartPointEndPoint(startPoint=byCoordinates_4, endPoint=byCoordinates_2)
perfil_montantes_final = StructuralFramingTypes("UB305x165x40")
beamByCurve_4 = StructuralFraming.BeamByCurve(curve=byStartPointEndPoint_4, level=nivel_inferior, structuralFramingType=perfil_montantes_final)
byStartPointEndPoint_5 = Line.ByStartPointEndPoint(startPoint=byCoordinates_3, endPoint=byCoordinates)
perfil_montantes_inicial = StructuralFramingTypes("UB305x165x40")  # graph input
beamByCurve_5 = StructuralFraming.BeamByCurve(curve=byStartPointEndPoint_5, level=nivel_inferior, structuralFramingType=perfil_montantes_inicial)
